# Grasshopper definition 001_CoriolisEffect.gh (Grasshopper 1.0.7)
# plug-ins: RhinoCodePluginGH

# gpt-4 Transcript
# image transcripts not available for gpt-4
# contact mwickerson999@gmail.com
# gpt-4 Text Prompt
# Geometry Coriolis Effect
# Use this script editor template to create a script
#  for the C# node in grasshopper for rhino8 that
# models geometry for
# 
# 3D Data Visualization
# 
# and specifically to
# 
# create a parametric model of the information
# contained in this image upload
# 
# //Grasshopper Script Instance
# //#! csharp
# using System;
# using System.Collections;
# using System.Collections.Generic;
# using System.Drawing;
# 
# using Rhino;
# using Rhino.Geometry;
# 
# using Grasshopper;
# using Grasshopper.Kernel;
# using Grasshopper.Kernel.Data;
# using Grasshopper.Kernel.Types;
# 
# public class Script_Instance : GH_ScriptInstance
# {
#   /*
#     Members:
#       RhinoDoc RhinoDocument
#       GH_Document GrasshopperDocument
#       IGH_Component Component
#       int Iteration
# 
#     Methods (Virtual & overridable):
#       Print(string text)
#       Print(string format, params object[] args)
#       Reflect(object obj)
#       Reflect(object obj, string method_name)
#   */
# 
#   private void RunScript(object x, object y, out object a)
#   {
#     // Write your logic here
#     a = null;
#   }
# }
coriolis_effect = Script()  # -> out, A; disabled
# ---------- coriolis_effect: C# ----------
// Grasshopper Script Instance
using System;
using System.Collections;
using System.Collections.Generic;
using System.Drawing;

using Rhino;
using Rhino.Geometry;

using Grasshopper;
using Grasshopper.Kernel;
using Grasshopper.Kernel.Data;
using Grasshopper.Kernel.Types;

// Grasshopper Script Instance
// #! csharp
using System;
using System.Collections;
using System.Collections.Generic;
using System.Drawing;

using Rhino;
using Rhino.Geometry;

using Grasshopper;
using Grasshopper.Kernel;
using Grasshopper.Kernel.Data;
using Grasshopper.Kernel.Types;

public class Script_Instance : GH_ScriptInstance
{
  private void RunScript(object x, object y, out object A)
  {
    // Initialize a list of geometry to output
    List<GeometryBase> geometries = new List<GeometryBase>();

    // Define the center position for the sphere
    Point3d position = new Point3d(0, 0, 0); // Replace with calculated position based on the image data
    double radius = 1.0; // Replace with relevant size based on the image data
    Sphere sphere = new Sphere(position, radius);
    geometries.Add(sphere.ToNurbsSurface()); // Convert the sphere to a NURBS surface and add to geometries

    // Placeholder for Coriolis effect trajectory calculation
    // Here, you will need to implement the logic to calculate the trajectory of an object
    // based on the Coriolis effect equations provided in the image. This typically involves
    // physics calculations for the fictitious forces acting on the object in a rotating frame.
    // You will need to calculate the positions at different time intervals and use them to create the trajectory.
    List<Point3d> trajectoryPoints = new List<Point3d>();
    // TODO: Implement the trajectory calculation logic here
    
    // Example: Add calculated trajectory points to the list
    // trajectoryPoints.Add(new Point3d(1, 2, 3)); // Replace with actual calculations
    
    // Create a curve through the calculated points
    if (trajectoryPoints.Count > 1)
    {
        Curve trajectoryCurve = Curve.CreateInterpolatedCurve(trajectoryPoints, 3);
        geometries.Add(trajectoryCurve); // Add the trajectory curve to geometries
    }

    // Output the geometry
    A = geometries;
  }

  // <Custom additional code> 
  // Here you can add any functions or classes you need to help with calculations.
  // For example, you might need to define a method to convert angular speed and velocity into a force vector.
  
  // Override methods here if necessary
}
# ---------- end coriolis_effect ----------
coriolis_effect_2 = Script()  # -> out, A; disabled
# ---------- coriolis_effect_2: C# ----------
// Grasshopper Script Instance
using System;
using System.Collections;
using System.Collections.Generic;
using System.Drawing;

using Rhino;
using Rhino.Geometry;

using Grasshopper;
using Grasshopper.Kernel;
using Grasshopper.Kernel.Data;
using Grasshopper.Kernel.Types;

// Grasshopper Script Instance
// #! csharp
using System;
using System.Collections.Generic;
using Rhino.Geometry;

public class Script_Instance : GH_ScriptInstance
{
  private void RunScript(object x, object y, out object A)
  {
    // Define initial conditions
    Vector3d initialVelocity = new Vector3d(0, 10, 0); // Example initial velocity
    Point3d initialPosition = new Point3d(0, 0, 0); // Example initial position
    double mass = 1.0; // Mass of the object
    double omega = 0.1; // Angular velocity of the rotating reference frame
    double timeStep = 0.1; // Time step for the simulation
    int numSteps = 100; // Number of steps in the simulation

    // Initialize a list of points for the trajectory
    List<Point3d> trajectoryPoints = new List<Point3d> { initialPosition };

    // Initialize velocity
    Vector3d velocity = initialVelocity;

    // Placeholder for the Coriolis force calculation
    Vector3d coriolisForce;

    for(int i = 0; i < numSteps; i++)
    {
      // Calculate Coriolis force at the current step
      coriolisForce = CalculateCoriolisForce(mass, omega, velocity);

      // Update velocity and position based on the forces
      velocity += coriolisForce / mass * timeStep;
      Point3d newPosition = trajectoryPoints[trajectoryPoints.Count - 1] + velocity * timeStep;

      // Add new position to the trajectory points
      trajectoryPoints.Add(newPosition);
    }

    // Check if there are enough points to create a curve
    if (trajectoryPoints.Count > 1)
    {
      Curve trajectoryCurve = Curve.CreateInterpolatedCurve(trajectoryPoints, 3);
      if (trajectoryCurve != null)
      {
        A = trajectoryCurve; // Assign the curve to the output parameter
      }
      else
      {
        A = "Failed to create trajectory curve"; // Assign an error message if curve creation fails
      }
    }
    else
    {
      A = "Not enough points for trajectory"; // Assign an error message if not enough points
    }
  }

  // Function to calculate the Coriolis force
  private Vector3d CalculateCoriolisForce(double mass, double omega, Vector3d velocity)
  {
    // Coriolis force calculation
    Vector3d omegaVector = new Vector3d(0, 0, omega); // Angular velocity vector along the Z-axis
    Vector3d coriolisForce = -2 * mass * Vector3d.CrossProduct(omegaVector, velocity);
    return coriolisForce;
  }
}
# ---------- end coriolis_effect_2 ----------
panel = Panel(coriolis_effect_2.out)  # disabled
panel_2 = Panel(coriolis_effect.out)  # disabled
geometry = Geometry(coriolis_effect.A)  # disabled
geometry_2 = Geometry(coriolis_effect_2.A)  # disabled

# ----
# Oscillation Algorithm
# The oscillation algorithm can be use to animate
# any geometry that is driven by a number sliders.
# Simply swap out the number sliders at the
# multiplication node in the oscillation script.
trigger = Trigger(Interval=10, TimerInterval=10, Target=data_recorder)
data_recorder = DataRecorder("1", DataLimit=-10, RecordData=False)
list_length = ListLength(List=data_recorder)
division = Division(A=list_length, B=Slider(104, range=0..1000))
cosine = Cosine(Value=division)
sine = Sine(Value=division)
panel_3 = Panel([sine, cosine])
multiplication = Multiplication(A=cosine, B=Slider(5.42, range=0..10))
multiplication_2 = Multiplication(A=sine)

panel_4 = Panel(geometry_2)  # disabled
panel_5 = Panel(geometry)  # disabled
number_slider = Slider(0.6, range=0..10)
vector_xyz = VectorXYZ(XComponent=multiplication, YComponent=0, ZComponent=0)  # -> Vector, Length
vector_xyz_2 = VectorXYZ(XComponent="1", YComponent="1", ZComponent=0)  # -> Vector, Length
construct_point = ConstructPoint(XCoordinate=0, YCoordinate=0, ZCoordinate=0)
coriolis_effect_3 = Script(
    initialPosition=construct_point,
    initialVelocity=vector_xyz.Vector,
    mass=Slider(5.34, range=0..10),
    omegaVector=vector_xyz_2.Vector,
    timeStep=multiplication_2,
    numSteps=Slider(3, range=0..10))  # -> out, A; inputs initialPosition: Point3d, initialVelocity: Vector3d, mass: Double, omegaVector: Vector3d, timeStep: Double, numSteps: Int32
# ---------- coriolis_effect_3: C# ----------
// Grasshopper Script Instance
using System;
using System.Collections;
using System.Collections.Generic;
using System.Drawing;

using Rhino;
using Rhino.Geometry;

using Grasshopper;
using Grasshopper.Kernel;
using Grasshopper.Kernel.Data;
using Grasshopper.Kernel.Types;

public class Script_Instance : GH_ScriptInstance
{
  private void RunScript(
	Point3d initialPosition,
	Vector3d initialVelocity,
	double mass,
	Vector3d omegaVector,
	double timeStep,
	int numSteps,
	out object A)
  {
    // Initialize a list of points for the trajectory
    List<Point3d> trajectoryPoints = new List<Point3d> { initialPosition };

    // Initialize velocity
    Vector3d velocity = initialVelocity;

    // Simulation loop
    for(int i = 0; i < numSteps; i++)
    {
      // Calculate Coriolis force at the current step
      Vector3d coriolisForce = CalculateCoriolisForce(mass, omegaVector, velocity);

      // Update velocity and position based on the forces
      velocity += coriolisForce / mass * timeStep;
      Point3d newPosition = trajectoryPoints[i] + velocity * timeStep;

      // Add new position to the trajectory points
      trajectoryPoints.Add(newPosition);
    }

    // Check if there are enough points to create a curve
    if (trajectoryPoints.Count > 1)
    {
      Curve trajectoryCurve = Curve.CreateInterpolatedCurve(trajectoryPoints, 3);
      if (trajectoryCurve != null)
      {
        A = trajectoryCurve; // Assign the curve to the output parameter
      }
      else
      {
        A = "Failed to create trajectory curve"; // Assign an error message if curve creation fails
      }
    }
    else
    {
      A = "Not enough points for trajectory"; // Assign an error message if not enough points
    }
  }

  // Function to calculate the Coriolis force
  private Vector3d CalculateCoriolisForce(double mass, Vector3d omegaVector, Vector3d velocity)
  {
    // Coriolis force calculation
    Vector3d coriolisForce = -2 * mass * Vector3d.CrossProduct(omegaVector, velocity);
    return coriolisForce;
  }
}
# ---------- end coriolis_effect_3 ----------
panel_6 = Panel(coriolis_effect_3.out)
geometry_3 = Geometry(coriolis_effect_3.A)
polar_array = PolarArray(Geometry=geometry_3, Plane=PlaneXY(0, 0, 0), Count=10, Angle=6.283185307)  # -> Geometry, Transform
panel_7 = Panel(geometry_3)
