# Grasshopper definition 002_Bernoulli_Principle.gh (Grasshopper 1.0.7)
# plug-ins: RhinoCodePluginGH

# gpt-4 Transcript
# image transcripts not available for gpt-4
# contact mwickerson999@gmail.com
# gpt-4 Text Prompt
# Geometry Bernoulli's Principle
# Use this script editor template to create a script
#  for the C# node in grasshopper for rhino8 that
# models geometry for
# 
# 3D Data Visualization
# 
# and specifically to
# 
# create a parametric model of the information
# contained in this image upload
# 
# //Grasshopper Script Instance
# //#! csharp
# using System;
# using System.Collections;
# using System.Collections.Generic;
# using System.Drawing;
# 
# using Rhino;
# using Rhino.Geometry;
# 
# using Grasshopper;
# using Grasshopper.Kernel;
# using Grasshopper.Kernel.Data;
# using Grasshopper.Kernel.Types;
# 
# public class Script_Instance : GH_ScriptInstance
# {
#   /*
#     Members:
#       RhinoDoc RhinoDocument
#       GH_Document GrasshopperDocument
#       IGH_Component Component
#       int Iteration
# 
#     Methods (Virtual & overridable):
#       Print(string text)
#       Print(string format, params object[] args)
#       Reflect(object obj)
#       Reflect(object obj, string method_name)
#   */
# 
#   private void RunScript(object x, object y, out object a)
#   {
#     // Write your logic here
#     a = null;
#   }
# }
number_slider = Slider(2.92, range=0..10)
number_slider_2 = Slider(0.13, range=0..1)
number_slider_3 = Slider(0.77, range=0..1)

# ----
# Oscillation Algorithm
# The oscillation algorithm can be use to animate
# any geometry that is driven by a number sliders.
# Simply swap out the number sliders at the
# multiplication node in the oscillation script.
trigger = Trigger(Interval=10, TimerInterval=10, Target=data_recorder)
data_recorder = DataRecorder("1", DataLimit=-10, RecordData=False)
list_length = ListLength(List=data_recorder)
division = Division(A=list_length, B=Slider(104, range=0..1000))
cosine = Cosine(Value=division)
sine = Sine(Value=division)
panel = Panel([sine, cosine])
multiplication = Multiplication(A=cosine)
multiplication_2 = Multiplication(A=sine)

bernoulli_s_principle = Script(
    P1=number_slider,
    rho=Slider(4.92, range=0..10),
    g=Slider(10, range=0..10),
    h1=Slider(6.87, range=0..10),
    v1=Slider(10, range=0..10),
    h2=Slider(1, range=0..1),
    v2=Slider(0.33, range=0..1))  # -> out, P2; inputs P1: Double, rho: Double, g: Double, h1: Double, v1: Double, h2: Double, v2: Double
# ---------- bernoulli_s_principle: C# ----------
// Grasshopper Script Instance
using System;
using System.Collections;
using System.Collections.Generic;
using System.Drawing;

using Rhino;
using Rhino.Geometry;

using Grasshopper;
using Grasshopper.Kernel;
using Grasshopper.Kernel.Data;
using Grasshopper.Kernel.Types;

// Grasshopper Script Instance
// #! csharp
using System;
using Rhino.Geometry;

public class Script_Instance : GH_ScriptInstance
{
  private void RunScript(
	double P1,
	double rho,
	double g,
	double h1,
	double v1,
	double h2,
	double v2,
	out object P2)
  {
    // Check for physical correctness
    if(rho <= 0 || g <= 0)
    {
      P2 = "Density and gravity must be greater than zero.";
      return;
    }

    // Bernoulli's equation rearranged to solve for P2
    P2 = P1 + 0.5 * rho * Math.Pow(v1, 2) + rho * g * h1 - 0.5 * rho * Math.Pow(v2, 2) - rho * g * h2;
  }

  // <Custom additional code>
}
# ---------- end bernoulli_s_principle ----------
panel_2 = Panel(bernoulli_s_principle.out)
panel_3 = Panel(bernoulli_s_principle.P2)
absolute = Absolute(Value=multiplication_2)
absolute_2 = Absolute(Value=multiplication)
bernoulli_s_principle_2 = Script(
    P1=Slider(0, range=0..10),
    P2=Slider(0, range=0..10),
    rho=Slider(0, range=0..10),
    h1=Slider(0, range=0..10),
    h2=Slider(10, range=0..10),
    v1=absolute,
    v2=absolute_2)  # -> out, A, B; inputs P1: Double, P2: Double, rho: Double, h1: Double, h2: Double, v1: Double, v2: Double
# ---------- bernoulli_s_principle_2: C# ----------
// Grasshopper Script Instance
using System;
using System.Collections;
using System.Collections.Generic;
using System.Drawing;

using Rhino;
using Rhino.Geometry;

using Grasshopper;
using Grasshopper.Kernel;
using Grasshopper.Kernel.Data;
using Grasshopper.Kernel.Types;

public class Script_Instance : GH_ScriptInstance
{
  private void RunScript(
	double P1,
	double P2,
	double rho,
	double h1,
	double h2,
	double v1,
	double v2,
	out object A,
	out object B)
  {
    // Initialize A to null to ensure it is assigned
    A = null;
    B = null; // Initialize B to null for error messages

    // Validate inputs
    if (v1 <= 0 || v2 <= 0)
    {
      B = "Velocity must be greater than 0.";
      return;
    }

    // Calculate cross-sectional areas from velocities and an assumed flow rate Q
    double Q = 1.0; // Flow rate Q could also be an input parameter
    double A1 = Q / v1; // Area at point 1
    double A2 = Q / v2; // Area at point 2

    // Calculate radii for the pipe ends
    double r1 = Math.Sqrt(A1 / Math.PI);
    double r2 = Math.Sqrt(A2 / Math.PI);

    // Ensure radii are positive
    if (r1 <= 0 || r2 <= 0)
    {
      B = "Calculated radii must be greater than 0.";
      return;
    }

    // Create circles for the start and end of the pipe
    Circle circleStart = new Circle(new Plane(new Point3d(P1, rho, h1), Vector3d.ZAxis), r1);
    Circle circleEnd = new Circle(new Plane(new Point3d(P2, rho, h2), Vector3d.ZAxis), r2);

    // Create lofted Brep between the circles
    var curves = new List<Curve> { circleStart.ToNurbsCurve(), circleEnd.ToNurbsCurve() };
    var loftedBreps = Brep.CreateFromLoft(curves, Point3d.Unset, Point3d.Unset, LoftType.Straight, false);

    // Check if the loft operation was successful
    if (loftedBreps == null || loftedBreps.Length == 0)
    {
      B = "Loft operation failed to create pipe geometry.";
    }
    else
    {
      // Assign the lofted Brep to the output A
      A = loftedBreps[0];
    }
  }

  // <Custom additional code>
}
# ---------- end bernoulli_s_principle_2 ----------
geometry = Geometry(bernoulli_s_principle_2.A)
panel_4 = Panel(bernoulli_s_principle_2.out)
panel_5 = Panel([geometry, bernoulli_s_principle_2.B])
