# Grasshopper definition 003_Euler_Even_Zeta_Formula.gh (Grasshopper 1.0.7)
# plug-ins: RhinoCodePluginGH

# gpt-4 Transcript
# image transcripts not available for gpt-4
# contact mwickerson999@gmail.com
# gpt-4 Text Prompt
# Geometry Euler Even Zeta Formula
# Use this script editor template to create a script
#  for the C# node in grasshopper for rhino8 that
# models geometry for
# 
# 3D Data Visualization
# 
# and specifically to
# 
# create a parametric model of the information
# contained in this image upload
# 
# //Grasshopper Script Instance
# //#! csharp
# using System;
# using System.Collections;
# using System.Collections.Generic;
# using System.Drawing;
# 
# using Rhino;
# using Rhino.Geometry;
# 
# using Grasshopper;
# using Grasshopper.Kernel;
# using Grasshopper.Kernel.Data;
# using Grasshopper.Kernel.Types;
# 
# public class Script_Instance : GH_ScriptInstance
# {
#   /*
#     Members:
#       RhinoDoc RhinoDocument
#       GH_Document GrasshopperDocument
#       IGH_Component Component
#       int Iteration
# 
#     Methods (Virtual & overridable):
#       Print(string text)
#       Print(string format, params object[] args)
#       Reflect(object obj)
#       Reflect(object obj, string method_name)
#   */
# 
#   private void RunScript(object x, object y, out object a)
#   {
#     // Write your logic here
#     a = null;
#   }
# }
euler_even_zeta_formula = Script()  # -> out, A
# ---------- euler_even_zeta_formula: C# ----------
// Grasshopper Script Instance
using System;
using System.Collections;
using System.Collections.Generic;
using System.Drawing;

using Rhino;
using Rhino.Geometry;

using Grasshopper;
using Grasshopper.Kernel;
using Grasshopper.Kernel.Data;
using Grasshopper.Kernel.Types;

//Grasshopper Script Instance
//#! csharp
using System;
using System.Collections.Generic;
using Rhino.Geometry;

public class Script_Instance : GH_ScriptInstance
{
  private void RunScript(object x, object y, out object A)
  {
    // Adjust these lists according to the data you want to visualize
    List<double> evenIntegers = new List<double>(); // Even positive integers n
    List<double> bernoulliNumbers = new List<double>(); // Bernoulli numbers B_2n
    List<double> zetaValues = new List<double>(); // Zeta function values ζ(2n)

    // Dummy data - replace with actual calculations or inputs
    evenIntegers.Add(2);
    bernoulliNumbers.Add(1.0/6.0); // B2
    zetaValues.Add(Math.PI * Math.PI / 6); // ζ(2)

    // Create points for each term in the series
    List<Point3d> seriesPoints = new List<Point3d>();
    for (int i = 0; i < evenIntegers.Count; i++)
    {
      double n = evenIntegers[i];
      double Bn = bernoulliNumbers[i];
      double zetaValue = zetaValues[i];

      // Example: we're using 'n' for X, 'Bn' for Y, and 'zetaValue' for Z
      Point3d pt = new Point3d(n, Bn, zetaValue);
      seriesPoints.Add(pt);
    }

    // Visualize the series points
    A = seriesPoints;
  }

  // <Custom additional code> 

}
# ---------- end euler_even_zeta_formula ----------

# ----
# Oscillation Algorithm
# The oscillation algorithm can be use to animate
# any geometry that is driven by a number sliders.
# Simply swap out the number sliders at the
# multiplication node in the oscillation script.
trigger = Trigger(Interval=10, TimerInterval=10, Target=data_recorder)  # disabled
panel = Panel("1")  # disabled
data_recorder = DataRecorder(panel, DataLimit=-10, RecordData=False)  # disabled
number_slider = Slider(104, range=0..1000)  # disabled
list_length = ListLength(List=data_recorder)  # disabled
division = Division(A=list_length, B=number_slider)  # disabled
cosine = Cosine(Value=division)  # disabled
sine = Sine(Value=division)  # disabled
panel_2 = Panel([sine, cosine])  # disabled
multiplication = Multiplication(A=cosine)  # disabled
multiplication_2 = Multiplication(A=sine)  # disabled
absolute = Absolute(Value=multiplication_2)  # disabled
absolute_2 = Absolute(Value=multiplication)  # disabled

geometry = Geometry(euler_even_zeta_formula.A)
panel_3 = Panel(euler_even_zeta_formula.out)
euler_even_zeta_formula_2 = Script(numTerms=Slider(5, range=0..10))  # -> out, SeriesPoints, ZetaValues; inputs numTerms: Int32
# ---------- euler_even_zeta_formula_2: C# ----------
// Grasshopper Script Instance
using System;
using System.Collections;
using System.Collections.Generic;
using System.Drawing;

using Rhino;
using Rhino.Geometry;

using Grasshopper;
using Grasshopper.Kernel;
using Grasshopper.Kernel.Data;
using Grasshopper.Kernel.Types;

public class Script_Instance : GH_ScriptInstance
{
  private void RunScript(
	int numTerms,
	out object SeriesPoints,
	out object ZetaValues)
  {
    // Calculate Bernoulli numbers and Zeta function values
    List<double> bernoulliNumbers = CalculateBernoulliNumbers(numTerms);
    List<Point3d> seriesPoints = new List<Point3d>();
    List<Sphere> zetaSpheres = new List<Sphere>();
    
    for (int n = 1; n <= numTerms; n++)
    {
      double zetaValue = CalculateZeta(2 * n, bernoulliNumbers[n - 1]);
      Point3d pt = new Point3d(n * 10, 0, zetaValue * 100); // Scale for visibility
      seriesPoints.Add(pt);

      // Create a sphere at the point with radius proportional to the Zeta value
      Sphere sphere = new Sphere(pt, Math.Abs(zetaValue) * 2);
      zetaSpheres.Add(sphere);
    }

    // Set output
    SeriesPoints = seriesPoints;
    ZetaValues = zetaSpheres;
  }

  // <Custom additional code> 

  // Method to calculate Bernoulli numbers (placeholder, implement the actual calculation)
  private List<double> CalculateBernoulliNumbers(int numTerms)
  {
    // Replace this with the actual Bernoulli number calculation
    List<double> bNumbers = new List<double>();
    for (int i = 1; i <= numTerms; i++)
    {
      bNumbers.Add(1.0 / (6.0 * i)); // Dummy formula, replace with real one
    }
    return bNumbers;
  }

  // Method to calculate the Zeta function values for even positive integers
  private double CalculateZeta(int s, double bernoulliNumber)
  {
    // Replace this with the actual Zeta function calculation using the Bernoulli number
    return Math.Pow(Math.PI, s) * bernoulliNumber / Factorial(s); // Dummy formula, replace with real one
  }

  // Factorial calculation
  private double Factorial(int n)
  {
    if (n == 0) return 1;
    double fact = 1;
    for (int i = 1; i <= n; i++)
    {
      fact *= i;
    }
    return fact;
  }
}
# ---------- end euler_even_zeta_formula_2 ----------
panel_4 = Panel(geometry)
panel_5 = Panel(euler_even_zeta_formula_2.out)
geometry_2 = Geometry(euler_even_zeta_formula_2.SeriesPoints)
geometry_3 = Geometry(euler_even_zeta_formula_2.ZetaValues)
interpolate = Interpolate(Vertices=geometry_2, Degree=3, Periodic=False, KnotStyle=1)  # -> Curve, Length, Domain
entwine = Entwine(Branch00=geometry_2, Branch01=geometry_3, FlattenInputs=True)
panel_6 = Panel(entwine)
polar_array = PolarArray(Geometry=interpolate.Curve, Plane=PlaneXY(0, 0, 0), Count=10, Angle=6.283185307)  # -> Geometry, Transform
