# Grasshopper definition 004_Vandermonde_Matrix.gh (Grasshopper 1.0.7)
# plug-ins: RhinoCodePluginGH

# gpt-4 Transcript
# image transcripts not available for gpt-4
# contact mwickerson999@gmail.com
# gpt-4 Text Prompt
# Geometry Vandermonde Matric
# Use this script editor template to create a script
#  for the C# node in grasshopper for rhino8 that
# models geometry for
# 
# 3D Data Visualization
# 
# and specifically to
# 
# create a parametric model of the information
# contained in this image upload
# 
# //Grasshopper Script Instance
# //#! csharp
# using System;
# using System.Collections;
# using System.Collections.Generic;
# using System.Drawing;
# 
# using Rhino;
# using Rhino.Geometry;
# 
# using Grasshopper;
# using Grasshopper.Kernel;
# using Grasshopper.Kernel.Data;
# using Grasshopper.Kernel.Types;
# 
# public class Script_Instance : GH_ScriptInstance
# {
#   /*
#     Members:
#       RhinoDoc RhinoDocument
#       GH_Document GrasshopperDocument
#       IGH_Component Component
#       int Iteration
# 
#     Methods (Virtual & overridable):
#       Print(string text)
#       Print(string format, params object[] args)
#       Reflect(object obj)
#       Reflect(object obj, string method_name)
#   */
# 
#   private void RunScript(object x, object y, out object a)
#   {
#     // Write your logic here
#     a = null;
#   }
# }
vandermonde_matric = Script()  # -> out, A; disabled
# ---------- vandermonde_matric: C# ----------
// Grasshopper Script Instance
using System;
using System.Collections;
using System.Collections.Generic;
using System.Drawing;

using Rhino;
using Rhino.Geometry;

using Grasshopper;
using Grasshopper.Kernel;
using Grasshopper.Kernel.Data;
using Grasshopper.Kernel.Types;

//Grasshopper Script Instance
//#! csharp
using System;
using System.Collections.Generic;
using Rhino.Geometry;

public class Script_Instance : GH_ScriptInstance
{
  private void RunScript(object x, object y, out object A)
  {
    // Assuming x and y are inputs that define the α values and the range of powers

    // Placeholder for α values - replace with actual input data
    double[] alphaValues = new double[] { 1, 2, 3 }; // Example α values

    // Placeholder for the range of powers - replace with actual input data
    int powerMax = 3; // Example power range

    // Generate the points based on the Vandermonde matrix concept
    List<Point3d> points = new List<Point3d>();
    for(int i = 0; i < alphaValues.Length; i++)
    {
      for(int j = 0; j < powerMax; j++)
      {
        double z = Math.Pow(alphaValues[i], j);
        points.Add(new Point3d(i, j, z));
      }
    }

    // Create curves from the points
    List<Curve> curves = new List<Curve>();
    for(int i = 0; i < alphaValues.Length; i++)
    {
      List<Point3d> rowPoints = points.GetRange(i * powerMax, powerMax);
      Curve curve = Curve.CreateInterpolatedCurve(rowPoints, 3);
      curves.Add(curve);
    }

    // Optional: Create a lofted surface from the curves
    Brep[] loftedSurfaces = Brep.CreateFromLoft(curves, Point3d.Unset, Point3d.Unset, LoftType.Normal, false);

    // Set the output to the curves and surfaces
    A = loftedSurfaces.Length > 0 ? loftedSurfaces : curves;
  }

  // <Custom additional code> 
}
# ---------- end vandermonde_matric ----------

# ---- group: Primer
panel = Panel("1")

# ----
geometry = Geometry(vandermonde_matric.A)  # disabled
panel_2 = Panel(vandermonde_matric.out)  # disabled

# ---- group: Start Stop Reset
trigger = Trigger(Interval=10, TimerInterval=10, Target=data_recorder)
data_recorder = DataRecorder(panel, DataLimit=-10, RecordData=False)

# ----
panel_3 = Panel(geometry)  # disabled

# ----
# Oscillation Algorithm
# The oscillation algorithm can be used to animate
# 
# any geometry that is driven by a number slider.
# 
# Simply swap out the number sliders at the
# 
# multiplication node in the oscillation script.
list_length = ListLength(List=data_recorder)
speed = Slider(29, range=0..1000)
division = Division(A=list_length, B=speed)
sine = Sine(Value=division)
cosine = Cosine(Value=division)

# ---- group: Sin/Cos Outputs
panel_4 = Panel([sine, cosine])
multiplication = Multiplication(A=sine)
multiplication_2 = Multiplication(A=cosine)

# ----
construct_domain = ConstructDomain(DomainStart=multiplication, DomainEnd=multiplication_2)
range = Range(Domain=construct_domain, Steps=10)
vandermonde_matric_2 = Script(alphaValuesObj=range, powerMax=Slider(4, range=0..10))  # -> out, A, Det; inputs alphaValuesObj: list, powerMax: Int32
# ---------- vandermonde_matric_2: C# ----------
// Grasshopper Script Instance
using System;
using System.Collections;
using System.Collections.Generic;
using System.Drawing;

using Rhino;
using Rhino.Geometry;

using Grasshopper;
using Grasshopper.Kernel;
using Grasshopper.Kernel.Data;
using Grasshopper.Kernel.Types;

// Grasshopper Script Instance
// #! csharp
using System;
using System.Collections;
using System.Collections.Generic;
using System.Linq; // Required for LINQ extension methods
using Rhino.Geometry;

public class Script_Instance : GH_ScriptInstance
{
  private void RunScript(
	IEnumerable<object> alphaValuesObj,
	int powerMax,
	out object A,
	out object Det)
  {
    // Initialize the output in case of early return
    A = null;
    Det = null;

    // Check and cast alphaValuesObj to a List<double>
    List<double> alphaValues = null;
    if (alphaValuesObj is List<double>)
    {
        alphaValues = alphaValuesObj as List<double>;
    }
    else if (alphaValuesObj is IEnumerable enumerable)
    {
        alphaValues = enumerable.Cast<object>()
                                .Select(x => Convert.ToDouble(x))
                                .ToList();
    }
    else
    {
        Component.AddRuntimeMessage(GH_RuntimeMessageLevel.Error, "alphaValues must be a list of numbers.");
        return;
    }

    // Check if the input list is valid
    if (alphaValues == null || alphaValues.Count == 0)
    {
        Component.AddRuntimeMessage(GH_RuntimeMessageLevel.Error, "alphaValues must be a non-empty list of doubles.");
        return;
    }
    if (powerMax < 1)
    {
        Component.AddRuntimeMessage(GH_RuntimeMessageLevel.Error, "powerMax must be a positive integer.");
        return;
    }

    // Generate the points based on the Vandermonde matrix concept
    List<Point3d> points = new List<Point3d>();
    for (int i = 0; i < alphaValues.Count; i++)
    {
        for (int j = 0; j < powerMax; j++)
        {
            double z = Math.Pow(alphaValues[i], j);
            points.Add(new Point3d(i, j, z));
        }
    }

    // Create curves from the points
    List<Curve> curves = new List<Curve>();
    for (int i = 0; i < alphaValues.Count; i++)
    {
        List<Point3d> rowPoints = new List<Point3d>();
        for (int j = 0; j < powerMax; j++)
        {
            rowPoints.Add(points[i * powerMax + j]);
        }
        Curve curve = Curve.CreateInterpolatedCurve(rowPoints, 3);
        curves.Add(curve);
    }

    // Optional: Create a lofted surface from the curves if there are more than one curve
    Brep[] loftedSurfaces = null;
    if (curves.Count > 1)
    {
        loftedSurfaces = Brep.CreateFromLoft(curves, Point3d.Unset, Point3d.Unset, LoftType.Normal, false);
    }

    // Calculate the determinant of the Vandermonde matrix
    double determinant = 1;
    for (int i = 0; i < alphaValues.Count; i++)
    {
        for (int j = i + 1; j < alphaValues.Count; j++)
        {
            determinant *= alphaValues[j] - alphaValues[i];
        }
    }

    // Output the curves and surfaces
    A = loftedSurfaces != null ? loftedSurfaces : curves;
    Det = determinant;
  }

  // <Custom additional code> 
}
# ---------- end vandermonde_matric_2 ----------
panel_5 = Panel(vandermonde_matric_2.out)
geometry_2 = Geometry(vandermonde_matric_2.A)
panel_6 = Panel([geometry_2, vandermonde_matric_2.Det])

# ---- group: Absolute Values
absolute = Absolute(Value=multiplication)
absolute_2 = Absolute(Value=multiplication_2)
