# Grasshopper definition 005_Differtiation_Differentiability.gh (Grasshopper 1.0.7)
# plug-ins: RhinoCodePluginGH

# gpt-4 Transcript
# image transcripts not available for gpt-4
# contact mwickerson999@gmail.com
# gpt-4 Text Prompt
# Geometry Differentiation and Differentiability
# Use this script editor template to create a script
#  for the C# node in grasshopper for rhino8 that
# models geometry for
# 
# 3D Data Visualization
# 
# and specifically to
# 
# create a parametric model of the information
# contained in this image upload
# 
# //Grasshopper Script Instance
# //#! csharp
# using System;
# using System.Collections;
# using System.Collections.Generic;
# using System.Drawing;
# 
# using Rhino;
# using Rhino.Geometry;
# 
# using Grasshopper;
# using Grasshopper.Kernel;
# using Grasshopper.Kernel.Data;
# using Grasshopper.Kernel.Types;
# 
# public class Script_Instance : GH_ScriptInstance
# {
#   /*
#     Members:
#       RhinoDoc RhinoDocument
#       GH_Document GrasshopperDocument
#       IGH_Component Component
#       int Iteration
# 
#     Methods (Virtual & overridable):
#       Print(string text)
#       Print(string format, params object[] args)
#       Reflect(object obj)
#       Reflect(object obj, string method_name)
#   */
# 
#   private void RunScript(object x, object y, out object a)
#   {
#     // Write your logic here
#     a = null;
#   }
# }
differentiation = Script()  # -> out, A; disabled
# ---------- differentiation: C# ----------
// Grasshopper Script Instance
using System;
using System.Collections;
using System.Collections.Generic;
using System.Drawing;

using Rhino;
using Rhino.Geometry;

using Grasshopper;
using Grasshopper.Kernel;
using Grasshopper.Kernel.Data;
using Grasshopper.Kernel.Types;

// Grasshopper Script Instance
// #! csharp
using System;
using System.Collections.Generic;
using Rhino.Geometry;

public class Script_Instance : GH_ScriptInstance
{
  private void RunScript(object x, object y, out object A)
  {
    // Example of a function that takes a vector and returns its squared length
    Func<Vector3d, double> f = v => v.SquareLength;

    // The gradient of f at a given point a, approximated numerically
    Func<Vector3d, Vector3d> grad_f = a => {
      var h = 1e-6; // a small number for numerical derivative
      var grad = new Vector3d(
        (f(a + new Vector3d(h, 0, 0)) - f(a)) / h,
        (f(a + new Vector3d(0, h, 0)) - f(a)) / h,
        (f(a + new Vector3d(0, 0, h)) - f(a)) / h
      );
      return grad;
    };

    // A point in space to evaluate the gradient
    var point_a = new Vector3d(1, 2, 3); // Example point

    // Calculate the gradient at point_a
    var gradient_at_a = grad_f(point_a);

    // Create geometry based on the gradient, for example, a line representing the gradient vector
    var line = new Line(new Point3d(point_a), new Point3d(point_a + gradient_at_a));

    // Output the line
    A = line;
  }

  // Override this method to tell Grasshopper how to handle this script instance
  public override void BeforeRunScript()
  {
    // Any setup before running the script
  }
}
# ---------- end differentiation ----------
number_slider = Slider(2.12, range=0..10)  # disabled
number_slider_2 = Slider(1, range=0..1)

# ---- group: Primer
panel = Panel("1")

# ----
construct_point = ConstructPoint(XCoordinate=0, YCoordinate=0, ZCoordinate=0)  # disabled
geometry = Geometry(differentiation.A)  # disabled
panel_2 = Panel(differentiation.out)  # disabled

# ---- group: Start Stop Reset
trigger = Trigger(Interval=10, TimerInterval=10, Target=data_recorder)
data_recorder = DataRecorder(panel, DataLimit=-10, RecordData=False)

# ----
panel_3 = Panel(geometry)  # disabled
differentiation_2 = Script(p=construct_point, t=number_slider)  # -> out, A; inputs p: Point3d, t: Double; disabled
# ---------- differentiation_2: C# ----------
// Grasshopper Script Instance
using System;
using System.Collections;
using System.Collections.Generic;
using System.Drawing;

using Rhino;
using Rhino.Geometry;

using Grasshopper;
using Grasshopper.Kernel;
using Grasshopper.Kernel.Data;
using Grasshopper.Kernel.Types;

using System;
using Rhino.Geometry;

public class Script_Instance : GH_ScriptInstance
{
  private void RunScript(Point3d p, double t, out object A)
  {
    // The function f takes a point (x, y, z) and a parameter t
    // For example, f(x, y, z, t) = (x^2 + ty^2 + z^2)
    Func<double, double, double, double, double> f = (x, y, z, param) => x * x + param * y * y + z * z;

    // The gradient of f at a given point (x, y, z) and parameter t, approximated numerically
    Func<double, double, double, double, Vector3d> grad_f = (x, y, z, param) => {
      var h = 1e-6; // a small number for numerical derivative
      return new Vector3d(
        (f(x + h, y, z, param) - f(x, y, z, param)) / h,
        (f(x, y + h, z, param) - f(x, y, z, param)) / h,
        (f(x, y, z + h, param) - f(x, y, z, param)) / h
      );
    };

    // Calculate the gradient at point p with parameter t
    var gradient_at_p = grad_f(p.X, p.Y, p.Z, t);

    // Create a vector from the gradient
    var gradient_vector = new Vector3d(gradient_at_p);

    // Create a line that represents the gradient vector at point p
    var gradient_line = new Line(p, Point3d.Add(p, gradient_vector));

    // Output the gradient line
    A = gradient_line;
  }

  // <Custom additional code> 
}
# ---------- end differentiation_2 ----------

# ----
# Oscillation Algorithm
# The oscillation algorithm can be used to animate
# 
# any geometry that is driven by a number slider.
# 
# Simply swap out the number sliders at the
# 
# multiplication node in the oscillation script.
list_length = ListLength(List=data_recorder)
speed = Slider(5, range=0..1000)
division = Division(A=list_length, B=speed)
sine = Sine(Value=division)
cosine = Cosine(Value=division)

geometry_2 = Geometry(differentiation_2.A)  # disabled
panel_4 = Panel(differentiation_2.out)  # disabled
panel_5 = Panel(geometry_2)  # disabled

# ---- group: Sin/Cos Outputs
panel_6 = Panel([sine, cosine])
multiplication = Multiplication(A=sine)
multiplication_2 = Multiplication(A=cosine)

# ---- group: Absolute Values
absolute = Absolute(Value=multiplication)
absolute_2 = Absolute(Value=multiplication_2)

# ----
differentiation_3 = Script(t=absolute)  # -> out, A, B; inputs t: Double
# ---------- differentiation_3: C# ----------
// Grasshopper Script Instance
using System;
using System.Collections;
using System.Collections.Generic;
using System.Drawing;

using Rhino;
using Rhino.Geometry;

using Grasshopper;
using Grasshopper.Kernel;
using Grasshopper.Kernel.Data;
using Grasshopper.Kernel.Types;

using System;
using System.Collections.Generic;
using Rhino.Geometry;

public class Script_Instance : GH_ScriptInstance
{
  private void RunScript(double t, out object A, out object B)
  {
    // Define the function f(x, y, z, t) and its gradient
    Func<double, double, double, double, double> f = (x, y, z, param) => x * x + param * y * y + z * z;
    Func<double, double, double, double, Vector3d> grad_f = (x, y, z, param) => {
      double h = 1e-6; // Small step for numerical derivative
      return new Vector3d(
        (f(x + h, y, z, param) - f(x, y, z, param)) / h,
        (f(x, y + h, z, param) - f(x, y, z, param)) / h,
        (f(x, y, z + h, param) - f(x, y, z, param)) / h
      );
    };

    // Create a grid of points
    var points = new List<Point3d>();
    var gradientLines = new List<Line>();
    for (double x = -5; x <= 5; x += 0.5)
    {
      for (double y = -5; y <= 5; y += 0.5)
      {
        // For this example, we're visualizing a 2D function, so z is set to 0
        Point3d pt = new Point3d(x, y, 0);
        points.Add(pt);

        // Compute the gradient
        Vector3d gradient = grad_f(x, y, 0, t);

        // Create a line from the point in the direction of the gradient
        if (gradient.Length > 0) // Avoid division by zero
        {
          gradient.Unitize(); // Normalize the gradient vector
          gradient *= 0.2; // Scale the gradient for visualization purposes
          gradientLines.Add(new Line(pt, pt + gradient));
        }
      }
    }

    // Output the points and gradient lines
    A = points;
    B = gradientLines;
  }

  // <Custom additional code> 
}
# ---------- end differentiation_3 ----------
panel_7 = Panel(differentiation_3.out)
geometry_3 = Geometry(differentiation_3.A)
geometry_4 = Geometry(differentiation_3.B)
panel_8 = Panel(geometry_4)
