# Grasshopper definition 006_Intergration_by_Parts.gh (Grasshopper 1.0.7)
# plug-ins: RhinoCodePluginGH

# gpt-4 Transcript
# image transcripts not available for gpt-4
# contact mwickerson999@gmail.com
# gpt-4 Text Prompt
# Geometry Integration by Parts
# Use this script editor template to create a script
#  for the C# node in grasshopper for rhino8 that
# models geometry for
# 
# 3D Data Visualization
# 
# and specifically to
# 
# create a parametric model of the information
# contained in this image upload
# 
# //Grasshopper Script Instance
# //#! csharp
# using System;
# using System.Collections;
# using System.Collections.Generic;
# using System.Drawing;
# 
# using Rhino;
# using Rhino.Geometry;
# 
# using Grasshopper;
# using Grasshopper.Kernel;
# using Grasshopper.Kernel.Data;
# using Grasshopper.Kernel.Types;
# 
# public class Script_Instance : GH_ScriptInstance
# {
#   /*
#     Members:
#       RhinoDoc RhinoDocument
#       GH_Document GrasshopperDocument
#       IGH_Component Component
#       int Iteration
# 
#     Methods (Virtual & overridable):
#       Print(string text)
#       Print(string format, params object[] args)
#       Reflect(object obj)
#       Reflect(object obj, string method_name)
#   */
# 
#   private void RunScript(object x, object y, out object a)
#   {
#     // Write your logic here
#     a = null;
#   }
# }
integration_by_parts = Script()  # -> out, A; disabled
# ---------- integration_by_parts: C# ----------
// Grasshopper Script Instance
using System;
using System.Collections;
using System.Collections.Generic;
using System.Drawing;

using Rhino;
using Rhino.Geometry;

using Grasshopper;
using Grasshopper.Kernel;
using Grasshopper.Kernel.Data;
using Grasshopper.Kernel.Types;

// Grasshopper Script Instance
// #! csharp
using System;
using System.Collections.Generic;
using Rhino.Geometry;

public class Script_Instance : GH_ScriptInstance
{
  private void RunScript(object x, object y, out object A)
  {
    // Your data visualization logic will go here
    // For the purpose of this example, we're assuming that u and v are functions of a single variable
    // Replace these with the actual data or expressions you want to visualize

    // Define a range for the variable (for example, time or space)
    int dataRange = 100; // Change this based on your range of data

    // Generate sample data for u and v
    var u = new List<double>();
    var v = new List<double>();
    for (int i = 0; i < dataRange; i++)
    {
      u.Add(SomeFunctionOf(i)); // Replace with actual function for u
      v.Add(SomeOtherFunctionOf(i)); // Replace with actual function for v
    }

    // Create 3D representations of the functions
    Curve uCurve = CreateDataCurve(u);
    Curve vCurve = CreateDataCurve(v);

    // Create surfaces to represent the integral terms uv and ∫v du
    // These are conceptual and would need to be implemented based on your visualization strategy
    Surface integralSurfaceUV = CreateIntegralSurface(uCurve, vCurve);
    Surface integralSurfaceVU = CreateIntegralSurface(vCurve, uCurve);

    // Combine all the geometries into a single list
    var geometries = new List<GeometryBase> { uCurve, vCurve, integralSurfaceUV, integralSurfaceVU };

    // Output the geometries
    A = geometries;
  }

  // <Custom additional code> 

  private double SomeFunctionOf(int x)
  {
    // Placeholder for your actual function for u
    return Math.Sin(x);
  }

  private double SomeOtherFunctionOf(int x)
  {
    // Placeholder for your actual function for v
    return Math.Cos(x);
  }

  private Curve CreateDataCurve(List<double> data)
  {
    var points = new List<Point3d>();
    for (int i = 0; i < data.Count; i++)
    {
      // Map the data point to a position in space
      points.Add(new Point3d(i, data[i], 0));
    }
    return Curve.CreateInterpolatedCurve(points, 3);
  }

  private Surface CreateIntegralSurface(Curve curve1, Curve curve2)
  {
    // Conceptual method to create a surface that represents the integral
    // You would need to replace this with the actual logic for creating the integral surface
    // As an example, we'll create a lofted surface between the two curves
    var curves = new List<Curve> { curve1, curve2 };
    var loftedSurface = Brep.CreateFromLoft(curves, Point3d.Unset, Point3d.Unset, LoftType.Normal, false);
    return loftedSurface.Length > 0 ? loftedSurface[0].Surfaces[0] : null;
  }

  // </Custom additional code>
}
# ---------- end integration_by_parts ----------
geometry = Geometry(integration_by_parts.A)  # disabled
panel = Panel(integration_by_parts.out)  # disabled

# ---- group: Primer
panel_2 = Panel("1")

# ----
pi = Pi(Factor=1)
panel_3 = Panel(geometry)  # disabled

# ---- group: Start Stop Reset
trigger = Trigger(Interval=10, TimerInterval=10, Target=data_recorder)
data_recorder = DataRecorder(panel_2, DataLimit=-10, RecordData=False)

# ----
# Oscillation Algorithm
# The oscillation algorithm can be used to animate
# 
# any geometry that is driven by a number slider.
# 
# Simply swap out the number sliders at the
# 
# multiplication node in the oscillation script.
list_length = ListLength(List=data_recorder)
speed = Slider(131, range=0..1000)
division = Division(A=list_length, B=speed)
sine = Sine(Value=division)
cosine = Cosine(Value=division)

# ---- group: Sin/Cos Outputs
panel_4 = Panel([sine, cosine])
multiplication = Multiplication(A=sine, B=Slider(2, range=-2..2))
multiplication_2 = Multiplication(A=cosine, B=Slider(2, range=-2..2))

# ----
pi_2 = Pi(Factor=multiplication)
division_2 = Division(A=pi, B=multiplication_2)
# Integration
# by
# Parts
integration_by_parts_2 = Script(
    frequency=pi_2,
    amplitude=Slider(1, range=0..1),
    phaseShift=division_2,
    integrationStart=Slider(0, range=0..10),
    integrationEnd=Slider(2.25, range=0..10))  # -> out, uvSurface, integralUv, integralVdu; inputs frequency: Double, amplitude: Double, phaseShift: Double, integrationStart: Double, integrationEnd: Double
# ---------- integration_by_parts_2: C# ----------
// Grasshopper Script Instance
using System;
using System.Collections;
using System.Collections.Generic;
using System.Drawing;

using Rhino;
using Rhino.Geometry;

using Grasshopper;
using Grasshopper.Kernel;
using Grasshopper.Kernel.Data;
using Grasshopper.Kernel.Types;

public class Script_Instance : GH_ScriptInstance
{
  private void RunScript(
	double frequency,
	double amplitude,
	double phaseShift,
	double integrationStart,
	double integrationEnd,
	out object uvSurface,
	out object integralUv,
	out object integralVdu)
  {
    // Define the functions u(x) and v(x) as trigonometric functions
    Func<double, double> u = (x) => amplitude * Math.Sin(frequency * x + phaseShift);
    Func<double, double> v = (x) => amplitude * Math.Cos(frequency * x);

    // Create curves for u(x) and v(x)
    List<Point3d> uPoints = new List<Point3d>();
    List<Point3d> vPoints = new List<Point3d>();
    for(double x = integrationStart; x <= integrationEnd; x += (integrationEnd - integrationStart) / 100.0)
    {
      uPoints.Add(new Point3d(x, u(x), 0));
      vPoints.Add(new Point3d(x, v(x), 0));
    }
    Curve uCurve = Curve.CreateInterpolatedCurve(uPoints, 3);
    Curve vCurve = Curve.CreateInterpolatedCurve(vPoints, 3);

    // Create surfaces to represent the integrals
    uvSurface = CreateIntegralSurface(uCurve, vCurve, integrationStart, integrationEnd);

    // Calculate the integral of u*v
    integralUv = IntegrateByParts(u, v, integrationStart, integrationEnd);

    // Calculate the integral of v*du
    integralVdu = IntegrateByParts(v, u, integrationStart, integrationEnd, derivative: true);
  }

  // Function to create a surface representing the integral of two functions
  private Brep CreateIntegralSurface(Curve uCurve, Curve vCurve, double start, double end)
  {
    // Implementation of creating the surface between the two curves
    // This is a simplified version and does not represent the actual integral surface
    List<Curve> curves = new List<Curve> { uCurve, vCurve };
    Brep[] lofts = Brep.CreateFromLoft(curves, Point3d.Unset, Point3d.Unset, LoftType.Normal, false);
    return lofts.Length > 0 ? lofts[0] : null;
  }

  // Function to perform integration by parts numerically
  private double IntegrateByParts(Func<double, double> u, Func<double, double> v, double start, double end, bool derivative = false)
  {
    // Numerical integration by parts logic
    // For the sake of simplicity, a basic Riemann sum approach is used here
    // For a real implementation, use a more sophisticated numerical integration method
    double sum = 0.0;
    double delta = (end - start) / 100.0;
    for(double x = start; x < end; x += delta)
    {
      if (derivative)
      {
        // Integral of v * du
        double du = (u(x + delta) - u(x)) / delta;
        sum += v(x) * du * delta;
      }
      else
      {
        // Integral of u * dv
        double dv = (v(x + delta) - v(x)) / delta;
        sum += u(x) * dv * delta;
      }
    }
    return sum;
  }

  // <Custom additional code> 

  // You can add more custom functions or classes here that might help with your visualization

  // </Custom additional code> 
}
# ---------- end integration_by_parts_2 ----------
geometry_2 = Geometry(integration_by_parts_2.uvSurface)
panel_5 = Panel(integration_by_parts_2.out)
panel_6 = Panel([geometry_2, integration_by_parts_2.integralUv, integration_by_parts_2.integralVdu])

# ---- group: Absolute Values
absolute = Absolute(Value=multiplication)
absolute_2 = Absolute(Value=multiplication_2)
