# Grasshopper definition 006b_Intergration_by_Parts.gh (Grasshopper 1.0.7)
# plug-ins: RhinoCodePluginGH, Kangaroo2 Components

# gpt-4 Transcript
# image transcripts not available for gpt-4
# contact mwickerson999@gmail.com
# gpt-4 Text Prompt
# Geometry Integration by Parts
# Use this script editor template to create a script
#  for the C# node in grasshopper for rhino8 that
# models geometry for
# 
# 3D Data Visualization
# 
# and specifically to
# 
# create a parametric model of the information
# contained in this image upload
# 
# //Grasshopper Script Instance
# //#! csharp
# using System;
# using System.Collections;
# using System.Collections.Generic;
# using System.Drawing;
# 
# using Rhino;
# using Rhino.Geometry;
# 
# using Grasshopper;
# using Grasshopper.Kernel;
# using Grasshopper.Kernel.Data;
# using Grasshopper.Kernel.Types;
# 
# public class Script_Instance : GH_ScriptInstance
# {
#   /*
#     Members:
#       RhinoDoc RhinoDocument
#       GH_Document GrasshopperDocument
#       IGH_Component Component
#       int Iteration
# 
#     Methods (Virtual & overridable):
#       Print(string text)
#       Print(string format, params object[] args)
#       Reflect(object obj)
#       Reflect(object obj, string method_name)
#   */
# 
#   private void RunScript(object x, object y, out object a)
#   {
#     // Write your logic here
#     a = null;
#   }
# }
integration_by_parts = Script()  # -> out, A; disabled
# ---------- integration_by_parts: C# ----------
// Grasshopper Script Instance
using System;
using System.Collections;
using System.Collections.Generic;
using System.Drawing;

using Rhino;
using Rhino.Geometry;

using Grasshopper;
using Grasshopper.Kernel;
using Grasshopper.Kernel.Data;
using Grasshopper.Kernel.Types;

// Grasshopper Script Instance
// #! csharp
using System;
using System.Collections.Generic;
using Rhino.Geometry;

public class Script_Instance : GH_ScriptInstance
{
  private void RunScript(object x, object y, out object A)
  {
    // Your data visualization logic will go here
    // For the purpose of this example, we're assuming that u and v are functions of a single variable
    // Replace these with the actual data or expressions you want to visualize

    // Define a range for the variable (for example, time or space)
    int dataRange = 100; // Change this based on your range of data

    // Generate sample data for u and v
    var u = new List<double>();
    var v = new List<double>();
    for (int i = 0; i < dataRange; i++)
    {
      u.Add(SomeFunctionOf(i)); // Replace with actual function for u
      v.Add(SomeOtherFunctionOf(i)); // Replace with actual function for v
    }

    // Create 3D representations of the functions
    Curve uCurve = CreateDataCurve(u);
    Curve vCurve = CreateDataCurve(v);

    // Create surfaces to represent the integral terms uv and ∫v du
    // These are conceptual and would need to be implemented based on your visualization strategy
    Surface integralSurfaceUV = CreateIntegralSurface(uCurve, vCurve);
    Surface integralSurfaceVU = CreateIntegralSurface(vCurve, uCurve);

    // Combine all the geometries into a single list
    var geometries = new List<GeometryBase> { uCurve, vCurve, integralSurfaceUV, integralSurfaceVU };

    // Output the geometries
    A = geometries;
  }

  // <Custom additional code> 

  private double SomeFunctionOf(int x)
  {
    // Placeholder for your actual function for u
    return Math.Sin(x);
  }

  private double SomeOtherFunctionOf(int x)
  {
    // Placeholder for your actual function for v
    return Math.Cos(x);
  }

  private Curve CreateDataCurve(List<double> data)
  {
    var points = new List<Point3d>();
    for (int i = 0; i < data.Count; i++)
    {
      // Map the data point to a position in space
      points.Add(new Point3d(i, data[i], 0));
    }
    return Curve.CreateInterpolatedCurve(points, 3);
  }

  private Surface CreateIntegralSurface(Curve curve1, Curve curve2)
  {
    // Conceptual method to create a surface that represents the integral
    // You would need to replace this with the actual logic for creating the integral surface
    // As an example, we'll create a lofted surface between the two curves
    var curves = new List<Curve> { curve1, curve2 };
    var loftedSurface = Brep.CreateFromLoft(curves, Point3d.Unset, Point3d.Unset, LoftType.Normal, false);
    return loftedSurface.Length > 0 ? loftedSurface[0].Surfaces[0] : null;
  }

  // </Custom additional code>
}
# ---------- end integration_by_parts ----------
geometry = Geometry(integration_by_parts.A)  # disabled
panel = Panel(integration_by_parts.out)  # disabled

# ---- group: Primer
panel_2 = Panel("1")

# ----
pi = Pi(Factor=1)
panel_3 = Panel(geometry)  # disabled

# ---- group: Start Stop Reset
trigger = Trigger(Interval=10, TimerInterval=10, Target=data_recorder)
data_recorder = DataRecorder(panel_2, DataLimit=-10, RecordData=False)

# ----
# Oscillation Algorithm
# The oscillation algorithm can be used to animate
# 
# any geometry that is driven by a number slider.
# 
# Simply swap out the number sliders at the
# 
# multiplication node in the oscillation script.
list_length = ListLength(List=data_recorder)
speed = Slider(280, range=0..1000)
division = Division(A=list_length, B=speed)
sine = Sine(Value=division)
cosine = Cosine(Value=division)

# ---- group: Sin/Cos Outputs
panel_4 = Panel([sine, cosine])
multiplication = Multiplication(A=sine, B=Slider(2, range=-2..2))
multiplication_2 = Multiplication(A=cosine, B=Slider(2, range=-2..2))

# ---- group: Absolute Values
absolute = Absolute(Value=multiplication)
absolute_2 = Absolute(Value=multiplication_2)

# ----
pi_2 = Pi(Factor=absolute)
division_2 = Division(A=pi, B=absolute_2)
integration_by_parts_2 = Script(
    frequency=pi_2,
    amplitude=Slider(1, range=0..1),
    phaseShift=division_2,
    integrationStart=Slider(0, range=0..10),
    integrationEnd=Slider(2.25, range=0..10))  # -> out, model; inputs frequency: Double, amplitude: Double, phaseShift: Double, integrationStart: Double, integrationEnd: Double
# ---------- integration_by_parts_2: C# ----------
// Grasshopper Script Instance
using System;
using System.Collections;
using System.Collections.Generic;
using System.Drawing;

using Rhino;
using Rhino.Geometry;

using Grasshopper;
using Grasshopper.Kernel;
using Grasshopper.Kernel.Data;
using Grasshopper.Kernel.Types;

//Grasshopper Script Instance
//#! csharp
using System;
using System.Collections.Generic;
using Rhino.Geometry;

public class Script_Instance : GH_ScriptInstance
{
  private void RunScript(
	double frequency,
	double amplitude,
	double phaseShift,
	double integrationStart,
	double integrationEnd,
	out object model)
  {
    // Define the functions u(x), v(x), and w(x) as trigonometric functions
    // u(x) = amplitude * sin(frequency * x + phaseShift)
    // v(x) = amplitude * cos(frequency * x)
    // w(x) = amplitude * sin(frequency * x) * cos(frequency * x + phaseShift)
    Func<double, double> u = (x) => amplitude * Math.Sin(frequency * x + phaseShift);
    Func<double, double> v = (x) => amplitude * Math.Cos(frequency * x);
    Func<double, double> w = (x) => amplitude * Math.Sin(frequency * x) * Math.Cos(frequency * x + phaseShift);

    // Generate the points for the 3D curve
    List<Point3d> curvePoints = new List<Point3d>();
    for(double x = integrationStart; x <= integrationEnd; x += (integrationEnd - integrationStart) / 100.0)
    {
      double z = w(x); // Z-coordinate from the complex trig function
      curvePoints.Add(new Point3d(u(x), v(x), z));
    }

    // Create the 3D curve
    Curve curve3D = Curve.CreateInterpolatedCurve(curvePoints, 3);

    // Generate the model which is a list containing the 3D curve
    model = curve3D;
  }

  // <Custom additional code> 

  // You can add more custom functions or classes here that might help with your visualization

  // </Custom additional code> 
}
# ---------- end integration_by_parts_2 ----------
geometry_2 = Geometry(integration_by_parts_2.model)
panel_5 = Panel(integration_by_parts_2.out)
panel_6 = Panel(geometry_2)
multipipe = MultiPipe(
    Curves=geometry_2,
    NodeSize=Slider(0.2, range=0..1),
    EndOffset=1,
    StrutSize=1,
    Segment=0,
    KinkAngle=0.6,
    CubeFit=0,
    Caps=0)
brep_edges = BrepEdges(Brep=multipipe)  # -> Naked, Interior, NonManifold
multipipe_2 = MultiPipe(
    Curves=brep_edges.Naked,
    NodeSize=Slider(0.1, range=0..1),
    EndOffset=1,
    StrutSize=1,
    Segment=0,
    KinkAngle=0.6,
    CubeFit=0,
    Caps=0)
