# Grasshopper definition 007_Prime_Ideal_Splitting.gh (Grasshopper 1.0.7)
# plug-ins: RhinoCodePluginGH

# gpt-4 Transcript
# image transcripts not available for gpt-4
# contact mwickerson999@gmail.com
# gpt-4 Text Prompt
# Geometry Prime Ideal Splitting
# Use this script editor template to create a script
#  for the C# node in grasshopper for rhino8 that
# models geometry for
# 
# 3D Data Visualization
# 
# and specifically to
# 
# create a parametric model of the information
# contained in this image upload
# 
# //Grasshopper Script Instance
# //#! csharp
# using System;
# using System.Collections;
# using System.Collections.Generic;
# using System.Drawing;
# 
# using Rhino;
# using Rhino.Geometry;
# 
# using Grasshopper;
# using Grasshopper.Kernel;
# using Grasshopper.Kernel.Data;
# using Grasshopper.Kernel.Types;
# 
# public class Script_Instance : GH_ScriptInstance
# {
#   /*
#     Members:
#       RhinoDoc RhinoDocument
#       GH_Document GrasshopperDocument
#       IGH_Component Component
#       int Iteration
# 
#     Methods (Virtual & overridable):
#       Print(string text)
#       Print(string format, params object[] args)
#       Reflect(object obj)
#       Reflect(object obj, string method_name)
#   */
# 
#   private void RunScript(object x, object y, out object a)
#   {
#     // Write your logic here
#     a = null;
#   }
# }
prime_ideal_splitting = Script()  # -> out, A; disabled
# ---------- prime_ideal_splitting: C# ----------
// Grasshopper Script Instance
using System;
using System.Collections;
using System.Collections.Generic;
using System.Drawing;

using Rhino;
using Rhino.Geometry;

using Grasshopper;
using Grasshopper.Kernel;
using Grasshopper.Kernel.Data;
using Grasshopper.Kernel.Types;

public class Script_Instance : GH_ScriptInstance
{
  private void RunScript(object x, object y, out object A)
  {
    // Example data - replace this with your actual input for prime ideals and exponents
    var primeSplittings = new List<List<int>>
    {
      new List<int> {1},        // Example of an inert prime (n = 1, e = 1)
      new List<int> {1, 1},     // Example of an unramified prime (e_i = 1 for all i)
      new List<int> {2, 1}      // Example of a ramified prime (e_i > 1 for some i)
    };

    // Adjust the scale to fit the model space if necessary
    double scale = 1.0;
    
    // Initialize the list to store the resulting geometries
    var geometries = new List<GeometryBase>();

    // The base point for the first set of geometries
    Point3d basePoint = new Point3d(0, 0, 0);

    // Iterate through each set of prime ideal splittings
    for (int i = 0; i < primeSplittings.Count; i++)
    {
      var primeGroup = primeSplittings[i];
      for (int j = 0; j < primeGroup.Count; j++)
      {
        // Calculate the position and height of the cylinder
        Point3d cylinderBase = new Point3d(basePoint.X + (i * scale * 2), basePoint.Y + (j * scale * 2), basePoint.Z);
        double height = primeGroup[j] * scale;
        
        // Create the cylinder at the calculated position
        Circle baseCircle = new Circle(cylinderBase, scale * 0.5);
        Cylinder cylinder = new Cylinder(baseCircle, height);

        // Add the cylinder to the geometry list
        geometries.Add(cylinder.ToBrep(true, true));
      }
    }

    // Assign the geometries to the output parameter
    A = geometries;
  }

  // <Custom additional code> 
}
# ---------- end prime_ideal_splitting ----------
geometry = Geometry(prime_ideal_splitting.A)  # disabled
panel = Panel(prime_ideal_splitting.out)  # disabled

# ---- group: Primer
panel_2 = Panel("1")

# ----
panel_3 = Panel(geometry)  # disabled
script = Script()  # -> out, A
# ---------- script: C# ----------
// Grasshopper Script Instance
using System;
using System.Collections;
using System.Collections.Generic;
using System.Drawing;

using Rhino;
using Rhino.Geometry;

using Grasshopper;
using Grasshopper.Kernel;
using Grasshopper.Kernel.Data;
using Grasshopper.Kernel.Types;

// Grasshopper Script Instance
//#! csharp
using System;
using System.Collections.Generic;
using Rhino.Geometry;

public class Script_Instance : GH_ScriptInstance
{
  // Override the RunScript method to create our geometry
  public override void RunScript(object x, object y, ref object A)
  {
    // Example data - replace this with your actual input for prime ideals and exponents
    var primeSplittings = new List<List<int>> {
      new List<int> {1},        // Example of an inert prime (n = 1, e = 1)
      new List<int> {1, 1},     // Example of an unramified prime (e_i = 1 for all i)
      new List<int> {2, 1},     // Example of a ramified prime (e_i > 1 for some i)
      new List<int> {3, 2, 1}   // Another example of a ramified prime
    };

    // Adjust the scale to fit the model space if necessary
    double scale = 1.0;

    // Initialize the list to store the resulting geometries
    var geometries = new List<GeometryBase>();

    // The base point for the first set of geometries
    Point3d basePoint = new Point3d(0, 0, 0);

    // Spacing constants to avoid overlap of geometries
    double xSpacing = 5.0 * scale;
    double ySpacing = 5.0 * scale;

    // Iterate through each set of prime ideal splittings
    for (int i = 0; i < primeSplittings.Count; i++)
    {
      var primeGroup = primeSplittings[i];
      Point3d groupBasePoint = new Point3d(basePoint.X + (i * xSpacing), basePoint.Y, basePoint.Z);

      for (int j = 0; j < primeGroup.Count; j++)
      {
        // Calculate the height of the geometry based on the exponent
        double height = primeGroup[j] * scale;
        Point3d geometryBase = new Point3d(groupBasePoint.X, groupBasePoint.Y + (j * ySpacing), groupBasePoint.Z);

        // Determine the type of geometry to create based on the type of prime
        if (primeGroup.Count == 1 && primeGroup[j] == 1)
        {
          // Inert prime: Represent with a sphere
          Sphere sphere = new Sphere(geometryBase, scale);
          geometries.Add(sphere.ToBrep());
        }
        else if (primeGroup[j] == 1)
        {
          // Unramified prime: Represent with a cylinder
          Circle baseCircle = new Circle(geometryBase, scale * 0.5);
          Cylinder cylinder = new Cylinder(baseCircle, height);
          geometries.Add(cylinder.ToBrep(true, true));
        }
        else
        {
          // Ramified prime: Represent with a cone
          Plane basePlane = new Plane(geometryBase, Vector3d.ZAxis);
          Cone cone = new Cone(basePlane, scale * 0.5, height);
          geometries.Add(cone.ToBrep(true));
        }
      }
    }

    // Assign the geometries to the output parameter
    A = geometries;
  }

  // <Custom additional code> 
}
# ---------- end script ----------
prime_ideal_splitting_2 = Script()  # -> out, A
# ---------- prime_ideal_splitting_2: C# ----------
// Grasshopper Script Instance
using System;
using System.Collections;
using System.Collections.Generic;
using System.Drawing;

using Rhino;
using Rhino.Geometry;

using Grasshopper;
using Grasshopper.Kernel;
using Grasshopper.Kernel.Data;
using Grasshopper.Kernel.Types;

// Grasshopper Script Instance
//#! csharp
using System;
using System.Collections.Generic;
using Rhino.Geometry;

public class Script_Instance : GH_ScriptInstance
{
  public override void RunScript(object x, object y, ref object A)
  {
    // Example data - replace this with your actual input for prime ideals and exponents
    var primeSplittings = new List<List<int>> {
      new List<int> {1},        // Example of an inert prime (n = 1, e = 1)
      new List<int> {1, 1},     // Example of an unramified prime (e_i = 1 for all i)
      new List<int> {2, 1},     // Example of a ramified prime (e_i > 1 for some i)
      new List<int> {3, 2, 1}   // Another example of a ramified prime
    };

    // Adjust the scale to fit the model space if necessary
    double scale = 1.0;

    // Initialize the list to store the resulting geometries
    var geometries = new List<GeometryBase>();

    // The base point for the first set of geometries
    Point3d basePoint = new Point3d(0, 0, 0);

    // Spacing constants to avoid overlap of geometries
    double xSpacing = 5.0 * scale;
    double ySpacing = 5.0 * scale;

    // Iterate through each set of prime ideal splittings
    for(int i = 0; i < primeSplittings.Count; i++) {
      var primeGroup = primeSplittings[i];
      Point3d groupBasePoint = new Point3d(basePoint.X + (i * xSpacing), basePoint.Y, basePoint.Z);

      for(int j = 0; j < primeGroup.Count; j++) {
        // Calculate the height of the geometry based on the exponent
        double height = primeGroup[j] * scale;
        Point3d geometryBase = new Point3d(groupBasePoint.X, groupBasePoint.Y + (j * ySpacing), groupBasePoint.Z);

        // Determine the type of geometry to create based on the type of prime
        if(primeGroup.Count == 1 && primeGroup[j] == 1) {
          // Inert prime: Represent with a sphere
          Sphere sphere = new Sphere(geometryBase, scale);
          geometries.Add(sphere.ToBrep());
        } else if(primeGroup[j] == 1) {
          // Unramified prime: Represent with a cylinder
          Circle baseCircle = new Circle(geometryBase, scale * 0.5);
          Cylinder cylinder = new Cylinder(baseCircle, height);
          geometries.Add(cylinder.ToBrep(true, true));
        } else {
          // Ramified prime: Represent with a cone
          Circle baseCircle = new Circle(geometryBase, scale * 0.5);
          Point3d apexPoint = new Point3d(geometryBase.X, geometryBase.Y, geometryBase.Z + height);
          Cone cone = new Cone(baseCircle, height);
          geometries.Add(cone.ToBrep(true));
        }
      }
    }

    // Assign the geometries to the output parameter
    A = geometries;
  }

  // <Custom additional code> 
}
# ---------- end prime_ideal_splitting_2 ----------

# ---- group: Start Stop Reset
trigger = Trigger(Interval=10, TimerInterval=10, Target=data_recorder)
data_recorder = DataRecorder(panel_2, DataLimit=-10, RecordData=False)

# ----
geometry_2 = Geometry(prime_ideal_splitting_2.A)
panel_4 = Panel(prime_ideal_splitting_2.out)
panel_5 = Panel(geometry_2)

# ----
# Oscillation Algorithm
# The oscillation algorithm can be used to animate
# 
# any geometry that is driven by a number slider.
# 
# Simply swap out the number sliders at the
# 
# multiplication node in the oscillation script.
list_length = ListLength(List=data_recorder)
speed = Slider(280, range=0..1000)
division = Division(A=list_length, B=speed)
sine = Sine(Value=division)
cosine = Cosine(Value=division)

# ---- group: Sin/Cos Outputs
panel_6 = Panel([sine, cosine])
multiplication = Multiplication(A=sine)
multiplication_2 = Multiplication(A=cosine)

# ---- group: Absolute Values
absolute = Absolute(Value=multiplication)
absolute_2 = Absolute(Value=multiplication_2)
