# Grasshopper definition 007b_Prime_Ideal_Splitting.gh (Grasshopper 1.0.7)
# plug-ins: RhinoCodePluginGH

panel = Panel("""0
0""")
panel_2 = Panel("""1
1
1
1""")
panel_3 = Panel("""2
1
1
1""")
# gpt-4 Transcript
# image transcripts not available for gpt-4
# contact mwickerson999@gmail.com
# gpt-4 Text Prompt
# Geometry Prime Ideal Splitting
# Use this script editor template to create a script
#  for the C# node in grasshopper for rhino8 that
# models geometry for
# 
# 3D Data Visualization
# 
# and specifically to
# 
# create a parametric model of the information
# contained in this image upload
# 
# //Grasshopper Script Instance
# //#! csharp
# using System;
# using System.Collections;
# using System.Collections.Generic;
# using System.Drawing;
# 
# using Rhino;
# using Rhino.Geometry;
# 
# using Grasshopper;
# using Grasshopper.Kernel;
# using Grasshopper.Kernel.Data;
# using Grasshopper.Kernel.Types;
# 
# public class Script_Instance : GH_ScriptInstance
# {
#   /*
#     Members:
#       RhinoDoc RhinoDocument
#       GH_Document GrasshopperDocument
#       IGH_Component Component
#       int Iteration
# 
#     Methods (Virtual & overridable):
#       Print(string text)
#       Print(string format, params object[] args)
#       Reflect(object obj)
#       Reflect(object obj, string method_name)
#   */
# 
#   private void RunScript(object x, object y, out object a)
#   {
#     // Write your logic here
#     a = null;
#   }
# }
prime_ideal_splitting = Script()  # -> out, A; disabled
# ---------- prime_ideal_splitting: C# ----------
// Grasshopper Script Instance
using System;
using System.Collections;
using System.Collections.Generic;
using System.Drawing;

using Rhino;
using Rhino.Geometry;

using Grasshopper;
using Grasshopper.Kernel;
using Grasshopper.Kernel.Data;
using Grasshopper.Kernel.Types;

public class Script_Instance : GH_ScriptInstance
{
  private void RunScript(object x, object y, out object A)
  {
    // Example data - replace this with your actual input for prime ideals and exponents
    var primeSplittings = new List<List<int>>
    {
      new List<int> {1},        // Example of an inert prime (n = 1, e = 1)
      new List<int> {1, 1},     // Example of an unramified prime (e_i = 1 for all i)
      new List<int> {2, 1}      // Example of a ramified prime (e_i > 1 for some i)
    };

    // Adjust the scale to fit the model space if necessary
    double scale = 1.0;
    
    // Initialize the list to store the resulting geometries
    var geometries = new List<GeometryBase>();

    // The base point for the first set of geometries
    Point3d basePoint = new Point3d(0, 0, 0);

    // Iterate through each set of prime ideal splittings
    for (int i = 0; i < primeSplittings.Count; i++)
    {
      var primeGroup = primeSplittings[i];
      for (int j = 0; j < primeGroup.Count; j++)
      {
        // Calculate the position and height of the cylinder
        Point3d cylinderBase = new Point3d(basePoint.X + (i * scale * 2), basePoint.Y + (j * scale * 2), basePoint.Z);
        double height = primeGroup[j] * scale;
        
        // Create the cylinder at the calculated position
        Circle baseCircle = new Circle(cylinderBase, scale * 0.5);
        Cylinder cylinder = new Cylinder(baseCircle, height);

        // Add the cylinder to the geometry list
        geometries.Add(cylinder.ToBrep(true, true));
      }
    }

    // Assign the geometries to the output parameter
    A = geometries;
  }

  // <Custom additional code> 
}
# ---------- end prime_ideal_splitting ----------
prime_ideal_splitting_2 = Script()  # -> out, A; disabled
# ---------- prime_ideal_splitting_2: C# ----------
// Grasshopper Script Instance
using System;
using System.Collections;
using System.Collections.Generic;
using System.Drawing;

using Rhino;
using Rhino.Geometry;

using Grasshopper;
using Grasshopper.Kernel;
using Grasshopper.Kernel.Data;
using Grasshopper.Kernel.Types;

// Grasshopper Script Instance
using System;
using System.Collections.Generic;
using Rhino.Geometry;

public class Script_Instance : GH_ScriptInstance
{
  private void RunScript(object x, object y, out object A)
  {
    // Define the data structure for prime ideals with their ramification indices
    var primeSplittings = new Dictionary<int, List<(int, int)>>()
    {
      {2, new List<(int, int)> { (1, 1) } },          // Inert prime example
      {3, new List<(int, int)> { (1, 1), (1, 1) } },  // Unramified prime example
      {5, new List<(int, int)> { (2, 1), (1, 1) } }   // Ramified prime example
    };

    // Initialize the list to store the resulting geometries
    var geometries = new List<GeometryBase>();

    // The base point for the first set of geometries
    Point3d basePoint = new Point3d(0, 0, 0);
    double scale = 1.0; // Adjust the scale to fit the model space if necessary
    double layerHeight = 5.0;

    // Iterate through each prime ideal splitting
    foreach (var primeEntry in primeSplittings)
    {
      int prime = primeEntry.Key;
      var splits = primeEntry.Value;
      Point3d primeBasePoint = basePoint;
      primeBasePoint.X += scale * prime;

      // Create a sphere to represent the prime ideal
      Sphere primeSphere = new Sphere(primeBasePoint, scale * 0.75);
      geometries.Add(primeSphere.ToBrep());

      // For each split, create branches and leaves
      for (int i = 0; i < splits.Count; i++)
      {
        var (e, f) = splits[i];
        Point3d branchBase = new Point3d(primeBasePoint.X, primeBasePoint.Y + (i * layerHeight * scale), primeBasePoint.Z);

        // Create branches as cylinders
        Cylinder branch = new Cylinder(new Circle(branchBase, scale * 0.25 * e), layerHeight * f);
        geometries.Add(branch.ToBrep(true, true));

        // Add leaves to represent individual prime ideals
        for (int leafIdx = 0; leafIdx < f; leafIdx++)
        {
          Point3d leafBase = branchBase;
          leafBase.Y += leafIdx * scale;
          Sphere leaf = new Sphere(leafBase, scale * 0.15);
          geometries.Add(leaf.ToBrep());
        }
      }
    }

    // Assign the geometries to the output parameter
    A = geometries;
  }
}
# ---------- end prime_ideal_splitting_2 ----------
number_slider = Slider(2, range=0..10)
geometry = Geometry(prime_ideal_splitting_2.A)  # disabled
panel_4 = Panel("""1
1""")
geometry_2 = Geometry(prime_ideal_splitting.A)  # disabled
panel_5 = Panel("""2
1""")
panel_6 = Panel(prime_ideal_splitting.out)  # disabled

# ---- group: Primer
panel_7 = Panel("1")

# ----
panel_8 = Panel(prime_ideal_splitting_2.out)  # disabled
panel_9 = Panel(geometry_2)  # disabled

# ---- group: Start Stop Reset
trigger = Trigger(Interval=10, TimerInterval=10, Target=data_recorder)
data_recorder = DataRecorder(panel_7, DataLimit=-10, RecordData=False)

# ----
entwine = Entwine(Branch0X=panel_4, Branch1X=panel, FlattenInputs=False)
entwine_2 = Entwine(Branch0X=panel_4, Branch1X=panel_4, FlattenInputs=False)
entwine_3 = Entwine(Branch0X=panel_5, Branch1X=panel_4, FlattenInputs=False)
panel_10 = Panel("""2
3
5""")
panel_11 = Panel(geometry)  # disabled

# ----
# Oscillation Algorithm
# The oscillation algorithm can be used to animate
# 
# any geometry that is driven by a number slider.
# 
# Simply swap out the number sliders at the
# 
# multiplication node in the oscillation script.
list_length = ListLength(List=data_recorder)
speed = Slider(280, range=0..1000)
division = Division(A=list_length, B=speed)
sine = Sine(Value=division)
cosine = Cosine(Value=division)

entwine_4 = Entwine(Branch00=entwine, Branch01=entwine_2, Branch02=entwine_3, FlattenInputs=True)
panel_12 = Panel(entwine_4)
# Learn how to
# creating and
# visualize
# datatrees in C#
# with
# gpt-4 image/text
# prompts at
# Wickerson Studios
prime_ideal_splitting_3 = Script(
    inputPrimesObj=graft(panel_10),
    indicesTreeObj=panel_12,
    scale=Slider(1.39, range=0..10),
    layerHeight=Slider(1.73, range=0..10))  # -> out, A; inputs inputPrimesObj: list of Int32, indicesTreeObj: tree of Int32, scale: Double, layerHeight: Double
# ---------- prime_ideal_splitting_3: C# ----------
using System;
using System.Collections.Generic;
using System.Linq;
using Rhino.Geometry;
using Grasshopper;

using System;
using System.Collections.Generic;
using System.Linq;
using Rhino.Geometry;
using Grasshopper.Kernel.Data;  // Make sure to include this for DataTree
using Grasshopper.Kernel.Types; // Include if necessary for GH types

public class Script_Instance : GH_ScriptInstance
{
  private void RunScript(
	IEnumerable<int> inputPrimesObj,
	DataTree<int> indicesTreeObj,
	double scale,
	double layerHeight,
	out object A)
  {
    // Cast inputPrimesObj to List<int>
    if (!(inputPrimesObj is List<int> inputPrimes) || inputPrimes.Count == 0)
    {
      throw new ArgumentException("Input must be a non-empty list of integers for primes.");
    }

    // Cast indicesTreeObj to DataTree<int>
    if (!(indicesTreeObj is DataTree<int> indicesTree) || indicesTree.BranchCount == 0)
    {
      throw new ArgumentException("Input must be a non-empty tree of integers for indices.");
    }

    var geometries = new List<GeometryBase>();

    for (int i = 0; i < inputPrimes.Count; i++)
    {
      int prime = inputPrimes[i];
      List<int> indicesList = indicesTree.Branch(new GH_Path(i)).ToList();

      if (indicesList.Count % 2 != 0)
      {
        throw new ArgumentException("Each prime must have pairs of indices (e, f).");
      }

      Point3d primeBasePoint = new Point3d(i * scale * 3, 0, 0);
      Sphere primeSphere = new Sphere(primeBasePoint, scale * 0.75);
      geometries.Add(primeSphere.ToBrep());

      for (int j = 0; j < indicesList.Count; j += 2)
      {
        int e = indicesList[j];
        int f = indicesList[j + 1];
        Point3d branchBase = new Point3d(primeBasePoint.X, primeBasePoint.Y + (j / 2 * layerHeight * scale), primeBasePoint.Z);

        Cylinder branch = new Cylinder(new Circle(branchBase, scale * 0.25 * e), layerHeight * f);
        geometries.Add(branch.ToBrep(true, true));

        for (int k = 0; k < f; k++)
        {
          Point3d leafBase = new Point3d(branchBase.X, branchBase.Y + (k * scale), branchBase.Z);
          Sphere leaf = new Sphere(leafBase, scale * 0.15);
          geometries.Add(leaf.ToBrep());
        }
      }
    }

    A = geometries;
  }
}
# ---------- end prime_ideal_splitting_3 ----------
panel_13 = Panel(prime_ideal_splitting_3.out)
geometry_3 = Geometry(prime_ideal_splitting_3.A)

# ---- group: Sin/Cos Outputs
panel_14 = Panel([sine, cosine])
multiplication = Multiplication(A=sine)
multiplication_2 = Multiplication(A=cosine)

# ---- group: Absolute Values
absolute = Absolute(Value=multiplication)
absolute_2 = Absolute(Value=multiplication_2)

# ----
panel_15 = Panel(geometry_3)
