# Grasshopper definition 007c_Prime_Ideal_Splitting.gh (Grasshopper 1.0.7)
# plug-ins: RhinoCodePluginGH

# gpt-4 Transcript
# image transcripts not available for gpt-4
# contact mwickerson999@gmail.com
# gpt-4 Text Prompt
# Geometry Prime Ideal Splitting
# Use this script editor template to create a script
#  for the C# node in grasshopper for rhino8 that
# models geometry for
# 
# 3D Data Visualization
# 
# and specifically to
# 
# create a parametric model of the information
# contained in this image upload
# 
# //Grasshopper Script Instance
# //#! csharp
# using System;
# using System.Collections;
# using System.Collections.Generic;
# using System.Drawing;
# 
# using Rhino;
# using Rhino.Geometry;
# 
# using Grasshopper;
# using Grasshopper.Kernel;
# using Grasshopper.Kernel.Data;
# using Grasshopper.Kernel.Types;
# 
# public class Script_Instance : GH_ScriptInstance
# {
#   /*
#     Members:
#       RhinoDoc RhinoDocument
#       GH_Document GrasshopperDocument
#       IGH_Component Component
#       int Iteration
# 
#     Methods (Virtual & overridable):
#       Print(string text)
#       Print(string format, params object[] args)
#       Reflect(object obj)
#       Reflect(object obj, string method_name)
#   */
# 
#   private void RunScript(object x, object y, out object a)
#   {
#     // Write your logic here
#     a = null;
#   }
# }
prime_ideal_splitting = Script()  # -> out, A; disabled
# ---------- prime_ideal_splitting: C# ----------
// Grasshopper Script Instance
using System;
using System.Collections;
using System.Collections.Generic;
using System.Drawing;

using Rhino;
using Rhino.Geometry;

using Grasshopper;
using Grasshopper.Kernel;
using Grasshopper.Kernel.Data;
using Grasshopper.Kernel.Types;

public class Script_Instance : GH_ScriptInstance
{
  private void RunScript(object x, object y, out object A)
  {
    // Example data - replace this with your actual input for prime ideals and exponents
    var primeSplittings = new List<List<int>>
    {
      new List<int> {1},        // Example of an inert prime (n = 1, e = 1)
      new List<int> {1, 1},     // Example of an unramified prime (e_i = 1 for all i)
      new List<int> {2, 1}      // Example of a ramified prime (e_i > 1 for some i)
    };

    // Adjust the scale to fit the model space if necessary
    double scale = 1.0;
    
    // Initialize the list to store the resulting geometries
    var geometries = new List<GeometryBase>();

    // The base point for the first set of geometries
    Point3d basePoint = new Point3d(0, 0, 0);

    // Iterate through each set of prime ideal splittings
    for (int i = 0; i < primeSplittings.Count; i++)
    {
      var primeGroup = primeSplittings[i];
      for (int j = 0; j < primeGroup.Count; j++)
      {
        // Calculate the position and height of the cylinder
        Point3d cylinderBase = new Point3d(basePoint.X + (i * scale * 2), basePoint.Y + (j * scale * 2), basePoint.Z);
        double height = primeGroup[j] * scale;
        
        // Create the cylinder at the calculated position
        Circle baseCircle = new Circle(cylinderBase, scale * 0.5);
        Cylinder cylinder = new Cylinder(baseCircle, height);

        // Add the cylinder to the geometry list
        geometries.Add(cylinder.ToBrep(true, true));
      }
    }

    // Assign the geometries to the output parameter
    A = geometries;
  }

  // <Custom additional code> 
}
# ---------- end prime_ideal_splitting ----------
prime_ideal_splitting_2 = Script()  # -> out, A; disabled
# ---------- prime_ideal_splitting_2: C# ----------
// Grasshopper Script Instance
using System;
using System.Collections;
using System.Collections.Generic;
using System.Drawing;

using Rhino;
using Rhino.Geometry;

using Grasshopper;
using Grasshopper.Kernel;
using Grasshopper.Kernel.Data;
using Grasshopper.Kernel.Types;

// Grasshopper Script Instance
using System;
using System.Collections.Generic;
using Rhino.Geometry;

public class Script_Instance : GH_ScriptInstance
{
  private void RunScript(object x, object y, out object A)
  {
    // Define the data structure for prime ideals with their ramification indices
    var primeSplittings = new Dictionary<int, List<(int, int)>>()
    {
      {2, new List<(int, int)> { (1, 1) } },          // Inert prime example
      {3, new List<(int, int)> { (1, 1), (1, 1) } },  // Unramified prime example
      {5, new List<(int, int)> { (2, 1), (1, 1) } }   // Ramified prime example
    };

    // Initialize the list to store the resulting geometries
    var geometries = new List<GeometryBase>();

    // The base point for the first set of geometries
    Point3d basePoint = new Point3d(0, 0, 0);
    double scale = 1.0; // Adjust the scale to fit the model space if necessary
    double layerHeight = 5.0;

    // Iterate through each prime ideal splitting
    foreach (var primeEntry in primeSplittings)
    {
      int prime = primeEntry.Key;
      var splits = primeEntry.Value;
      Point3d primeBasePoint = basePoint;
      primeBasePoint.X += scale * prime;

      // Create a sphere to represent the prime ideal
      Sphere primeSphere = new Sphere(primeBasePoint, scale * 0.75);
      geometries.Add(primeSphere.ToBrep());

      // For each split, create branches and leaves
      for (int i = 0; i < splits.Count; i++)
      {
        var (e, f) = splits[i];
        Point3d branchBase = new Point3d(primeBasePoint.X, primeBasePoint.Y + (i * layerHeight * scale), primeBasePoint.Z);

        // Create branches as cylinders
        Cylinder branch = new Cylinder(new Circle(branchBase, scale * 0.25 * e), layerHeight * f);
        geometries.Add(branch.ToBrep(true, true));

        // Add leaves to represent individual prime ideals
        for (int leafIdx = 0; leafIdx < f; leafIdx++)
        {
          Point3d leafBase = branchBase;
          leafBase.Y += leafIdx * scale;
          Sphere leaf = new Sphere(leafBase, scale * 0.15);
          geometries.Add(leaf.ToBrep());
        }
      }
    }

    // Assign the geometries to the output parameter
    A = geometries;
  }
}
# ---------- end prime_ideal_splitting_2 ----------
number_slider = Slider(0.93, range=0..10)  # disabled
number_slider_2 = Slider(2.56, range=0..10)  # disabled
geometry = Geometry(prime_ideal_splitting_2.A)  # disabled
geometry_2 = Geometry(prime_ideal_splitting.A)  # disabled
panel = Panel(prime_ideal_splitting.out)  # disabled

# ---- group: Primer
panel_2 = Panel("1")

# ----
panel_3 = Panel(prime_ideal_splitting_2.out)  # disabled
panel_4 = Panel(geometry_2)  # disabled

# ---- group: Start Stop Reset
trigger = Trigger(Interval=10, TimerInterval=10, Target=data_recorder)
data_recorder = DataRecorder(panel_2, DataLimit=-10, RecordData=False)

# ----
prime_ideal_splitting_3 = Script(scale=number_slider, layerHeight=number_slider_2)  # -> out, A; inputs scale: Double, layerHeight: Double; disabled
# ---------- prime_ideal_splitting_3: C# ----------
using System;
using System.Collections.Generic;
using System.Linq;
using Rhino.Geometry;
using Grasshopper;

using System;
using System.Collections.Generic;
using System.Linq;
using Rhino.Geometry;
using Grasshopper.Kernel.Data;  // Make sure to include this for DataTree
using Grasshopper.Kernel.Types; // Include if necessary for GH types

public class Script_Instance : GH_ScriptInstance
{
  private void RunScript(double scale, double layerHeight, out object A)
  {
    // Hardcoded list of primes
    List<int> inputPrimes = new List<int> { 2, 3, 5 };

    // Hardcoded indices for each prime
    // This structure mimics a DataTree<int>
    var indicesTree = new Dictionary<int, List<int>>
    {
        { 2, new List<int> { 1, 1 } },          // Indices for prime 2
        { 3, new List<int> { 1, 1, 1, 1 } },   // Indices for prime 3
        { 5, new List<int> { 2, 1, 1, 1 } }    // Indices for prime 5
    };

    var geometries = new List<GeometryBase>();

    for (int i = 0; i < inputPrimes.Count; i++)
    {
      int prime = inputPrimes[i];
      List<int> indicesList = indicesTree[prime];

      Point3d primeBasePoint = new Point3d(i * scale * 3, 0, 0);
      Sphere primeSphere = new Sphere(primeBasePoint, scale * 0.75);
      geometries.Add(primeSphere.ToBrep());

      for (int j = 0; j < indicesList.Count; j += 2)
      {
        int e = indicesList[j];
        int f = indicesList[j + 1];
        Point3d branchBase = new Point3d(primeBasePoint.X, primeBasePoint.Y + (j / 2 * layerHeight * scale), primeBasePoint.Z);

        Cylinder branch = new Cylinder(new Circle(branchBase, scale * 0.25 * e), layerHeight * f);
        geometries.Add(branch.ToBrep(true, true));

        for (int k = 0; k < f; k++)
        {
          Point3d leafBase = new Point3d(branchBase.X, branchBase.Y + (k * scale), branchBase.Z);
          Sphere leaf = new Sphere(leafBase, scale * 0.15);
          geometries.Add(leaf.ToBrep());
        }
      }
    }

    A = geometries;
  }

  // <Custom additional code> 
}
# ---------- end prime_ideal_splitting_3 ----------
panel_5 = Panel(geometry)  # disabled

# ----
# Oscillation Algorithm
# The oscillation algorithm can be used to animate
# 
# any geometry that is driven by a number slider.
# 
# Simply swap out the number sliders at the
# 
# multiplication node in the oscillation script.
list_length = ListLength(List=data_recorder)
speed = Slider(280, range=0..1000)
division = Division(A=list_length, B=speed)
sine = Sine(Value=division)
cosine = Cosine(Value=division)

panel_6 = Panel(prime_ideal_splitting_3.out)  # disabled
geometry_3 = Geometry(prime_ideal_splitting_3.A)  # disabled
panel_7 = Panel(geometry_3)  # disabled

# ---- group: Sin/Cos Outputs
panel_8 = Panel([sine, cosine])
multiplication = Multiplication(A=sine)
multiplication_2 = Multiplication(A=cosine)

# ----
number_slider_3 = Slider(0.93, range=0..10)  # disabled
number_slider_4 = Slider(2.56, range=0..10)  # disabled
panel_9 = Panel("""2
3
5""")  # disabled

# ---- group: Absolute Values
absolute = Absolute(Value=multiplication)
absolute_2 = Absolute(Value=multiplication_2)

# ----
prime_ideal_splitting_4 = Script(inputPrimesObj=panel_9, scale=number_slider_3, layerHeight=number_slider_4)  # -> out, A; inputs inputPrimesObj: list of Int32, scale: Double, layerHeight: Double; disabled
# ---------- prime_ideal_splitting_4: C# ----------
// Grasshopper Script Instance
using System;
using System.Collections;
using System.Collections.Generic;
using System.Drawing;

using Rhino;
using Rhino.Geometry;

using Grasshopper;
using Grasshopper.Kernel;
using Grasshopper.Kernel.Data;
using Grasshopper.Kernel.Types;

using System;
using System.Collections.Generic;
using System.Linq; // For using LINQ methods such as .ToList()
using Rhino.Geometry;
using Grasshopper.Kernel.Data; // For DataTree

public class Script_Instance : GH_ScriptInstance
{
  private void RunScript(
	IEnumerable<int> inputPrimesObj,
	double scale,
	double layerHeight,
	out object A)
  {
    // Cast inputPrimesObj to IEnumerable<int>
    if (!(inputPrimesObj is IEnumerable<int> inputPrimesEnumerable))
    {
      throw new ArgumentException("Input must be a list of integers for primes.");
    }

    // Convert IEnumerable to List<int>
    List<int> inputPrimes = inputPrimesEnumerable.ToList();

    // Check if inputPrimes is not null or empty
    if (inputPrimes.Count == 0)
    {
      throw new ArgumentException("Input must be a non-empty list of integers for primes.");
    }

    // Hardcoded logic to determine indices for each prime
    var indicesTree = new Dictionary<int, List<int>>();
    foreach (var prime in inputPrimes)
    {
        if (prime % 2 == 0)
        {
            indicesTree.Add(prime, new List<int> { 1, 1 });
        }
        else
        {
            indicesTree.Add(prime, new List<int> { 1, 1, 1, 1 });
        }
    }

    var geometries = new List<GeometryBase>();

    for (int i = 0; i < inputPrimes.Count; i++)
    {
      int prime = inputPrimes[i];
      List<int> indicesList = indicesTree.ContainsKey(prime) ? indicesTree[prime] : new List<int> { 1, 1 }; // Default indices

      Point3d primeBasePoint = new Point3d(i * scale * 3, 0, 0);
      Sphere primeSphere = new Sphere(primeBasePoint, scale * 0.75);
      geometries.Add(primeSphere.ToBrep());

      for (int j = 0; j < indicesList.Count; j += 2)
      {
        int e = indicesList[j];
        int f = indicesList[j + 1];
        Point3d branchBase = new Point3d(primeBasePoint.X, primeBasePoint.Y + (j / 2 * layerHeight * scale), primeBasePoint.Z);

        Cylinder branch = new Cylinder(new Circle(branchBase, scale * 0.25 * e), layerHeight * f);
        geometries.Add(branch.ToBrep(true, true));

        for (int k = 0; k < f; k++)
        {
          Point3d leafBase = new Point3d(branchBase.X, branchBase.Y + (k * scale), branchBase.Z);
          Sphere leaf = new Sphere(leafBase, scale * 0.15);
          geometries.Add(leaf.ToBrep());
        }
      }
    }

    A = geometries;
  }

  // <Custom additional code> 
}
# ---------- end prime_ideal_splitting_4 ----------
panel_10 = Panel(prime_ideal_splitting_4.out)  # disabled
geometry_4 = Geometry(prime_ideal_splitting_4.A)  # disabled
panel_11 = Panel(geometry_4)  # disabled
panel_12 = Panel("""2
3
5
7
11""")
panel_13 = Panel("""1
1
1
1
1
1
2
1
1
1""")
prime_ideal_splitting_5 = Script(inputPrimesObj=panel_12, indicesObj=panel_13, scale=Slider(1.07, range=0..10), layerHeight=Slider(2.56, range=0..10))  # -> out, A; inputs inputPrimesObj: list of Int32, indicesObj: list of Int32, scale: Double, layerHeight: Double
# ---------- prime_ideal_splitting_5: C# ----------
// Grasshopper Script Instance
using System;
using System.Collections;
using System.Collections.Generic;
using System.Drawing;

using Rhino;
using Rhino.Geometry;

using Grasshopper;
using Grasshopper.Kernel;
using Grasshopper.Kernel.Data;
using Grasshopper.Kernel.Types;

using System;
using System.Collections.Generic;
using System.Linq; // For LINQ methods
using Rhino.Geometry;
using Grasshopper.Kernel.Data; // For DataTree

public class Script_Instance : GH_ScriptInstance
{
  private void RunScript(
	IEnumerable<int> inputPrimesObj,
	IEnumerable<int> indicesObj,
	double scale,
	double layerHeight,
	out object A)
  {
    // Cast inputPrimesObj to IEnumerable<int>
    if (!(inputPrimesObj is IEnumerable<int> inputPrimesEnumerable))
    {
      throw new ArgumentException("Input must be a list of integers for primes.");
    }

    // Convert IEnumerable to List<int>
    List<int> inputPrimes = inputPrimesEnumerable.ToList();

    // Check if inputPrimes is not null or empty
    if (inputPrimes.Count == 0)
    {
      throw new ArgumentException("Input must be a non-empty list of integers for primes.");
    }

    // Cast indicesObj to IEnumerable<int>
    if (!(indicesObj is IEnumerable<int> indicesEnumerable))
    {
      throw new ArgumentException("Indices input must be a list of integers.");
    }

    // Convert IEnumerable to List<int>
    List<int> indicesList = indicesEnumerable.ToList();

    // Organize indices into a DataTree<int>
    var indicesTree = new DataTree<int>();
    int indexCounter = 0;

    for (int i = 0; i < inputPrimes.Count && indexCounter < indicesList.Count; i++)
    {
      var path = new GH_Path(i);
      while (indexCounter < indicesList.Count)
      {
        indicesTree.Add(indicesList[indexCounter], path);
        indexCounter++;

        // Break if the end of a pair is reached
        if (indexCounter % 2 == 0) break;
      }
    }

    var geometries = new List<GeometryBase>();

    for (int i = 0; i < inputPrimes.Count; i++)
    {
      int prime = inputPrimes[i];
      List<int> indices = indicesTree.Branch(new GH_Path(i)).ToList();

      if(indices.Count % 2 != 0)
      {
        throw new ArgumentException("Indices for each prime must be in pairs.");
      }

      Point3d primeBasePoint = new Point3d(i * scale * 3, 0, 0);
      Sphere primeSphere = new Sphere(primeBasePoint, scale * 0.75);
      geometries.Add(primeSphere.ToBrep());

      for (int j = 0; j < indices.Count; j += 2)
      {
        int e = indices[j];
        int f = indices[j + 1];
        Point3d branchBase = new Point3d(primeBasePoint.X, primeBasePoint.Y + (j / 2 * layerHeight * scale), primeBasePoint.Z);

        Cylinder branch = new Cylinder(new Circle(branchBase, scale * 0.25 * e), layerHeight * f);
        geometries.Add(branch.ToBrep(true, true));

        for (int k = 0; k < f; k++)
        {
          Point3d leafBase = new Point3d(branchBase.X, branchBase.Y + (k * scale), branchBase.Z);
          Sphere leaf = new Sphere(leafBase, scale * 0.15);
          geometries.Add(leaf.ToBrep());
        }
      }
    }

    A = geometries;
  }

  // <Custom additional code> 
}
# ---------- end prime_ideal_splitting_5 ----------
panel_14 = Panel(prime_ideal_splitting_5.out)
geometry_5 = Geometry(prime_ideal_splitting_5.A)
panel_15 = Panel(geometry_5)
